# Dynamo custom node Get To-From Room.dyf (Dynamo 0.8.0.950)
# category: Sasaki-Dependency.Get To-From Room
# Extract the ToRoom / FromRoom from Doors or Windows

Elements = Input()
python_script = Python(IN[0]=Elements)
# ---------- python_script.python (54 lines) ----------
#Copyright(c) 2014, Dieter Vermeulen, Autodesk
#This script detects the "To Room / FromRoom" relation for all doors or windows, for all model phases.
#Elements with no "ToRoom / FromRoom" indication will be set as None
#More on http://revitbeyondbim.wordpress.com

import clr
# Import RevitAPI
clr.AddReference("RevitAPI")
import Autodesk
from Autodesk.Revit.DB import *

# Import DocumentManager and TransactionManager
clr.AddReference("RevitServices")
import RevitServices
from RevitServices.Persistence import DocumentManager
from RevitServices.Transactions import TransactionManager

# Import ToDSType(bool) extension method
clr.AddReference("RevitNodes")
import Revit
clr.ImportExtensions(Revit.Elements)

# Start Transaction
doc = DocumentManager.Instance.CurrentDBDocument
TransactionManager.Instance.EnsureInTransaction(doc)

#Declare list variables
ToRoom = []
FromRoom = []
elements = []

#unwrap inputs
for i in IN[0]:
	elements.append(UnwrapElement(i))

#List the "To Room" for all phases
for i in elements:
	for phase in doc.Phases:
		if i.CreatedPhaseId == phase.Id:
			try:
				to_room = i.ToRoom[phase]
				from_room=i.FromRoom[phase]
				ToRoom.append(to_room)
				FromRoom.append(from_room)
			except:
				ToRoom.append(None)
				FromRoom.append(None)
				continue			

# End Transaction
TransactionManager.Instance.TransactionTaskDone()

#Assign your output to the OUT variable
OUT = ToRoom, FromRoom
# ----------------------------------------
number = DoubleInput(0)
getItemAtIndex = List.GetItemAtIndex(list=python_script, index=number)
isNull = Object.IsNull(getItemAtIndex)
filterByBoolMask = List.FilterByBoolMask(list=getItemAtIndex, mask=isNull)
ToRooms = Output(filterByBoolMask.out)
number_2 = DoubleInput(1)
getItemAtIndex_2 = List.GetItemAtIndex(list=python_script, index=number_2)
isNull_2 = Object.IsNull(getItemAtIndex_2)
filterByBoolMask_2 = List.FilterByBoolMask(list=getItemAtIndex_2, mask=isNull_2)
FromRooms = Output(filterByBoolMask_2.out)
