# Dynamo custom node Viewport.Pts.dyf (Dynamo 0.9.0.3067)
# category: Sasaki-Dependency.Hollandaise
# Gets the min and max points of a viewport

viewport = Input()
python_script = Python(IN[0]=viewport)
# ---------- python_script.python (28 lines) ----------
# modified from a node in archi-lab by
# @arch_laboratory, http://archi-lab.net

import clr
clr.AddReference('ProtoGeometry')
from Autodesk.DesignScript.Geometry import *

# Import Element wrapper extension methods
clr.AddReference("RevitNodes")
import Revit
clr.ImportExtensions(Revit.Elements)

# Import geometry conversion extension methods
clr.ImportExtensions(Revit.GeometryConversion)


#The inputs to this node will be stored as a list in the IN variables.
dataEnteringNode = IN
pts=[]
v = UnwrapElement(IN[0])
outline = v.GetBoxOutline()
minpt=outline.MinimumPoint.ToPoint()
maxpt=outline.MaximumPoint.ToPoint()

pts.append(minpt)
pts.append(maxpt)
#Assign your output to the OUT variable.
OUT = pts
# ----------------------------------------
code_block = CodeBlock(x=python_script) { x[0]; x[1]; }
MinPt = Output(code_block.out0)
MaxPt = Output(code_block.out1)
