# Dynamo custom node WhatTheNode.dyf (Dynamo 1.0.0.1180)
# category: _WhatTheNode
# This is a duplicate of a node from Rhythm to help figure out what package custom nodes are from. It utilizes dynamonodes.com's database.

string = StringInput("https://dynamonodes.com/?s=")
nodeInQuestion = Input(nodeInQuestion : string)
code_block = CodeBlock { " "; "+"; }
replace = String.Replace(str=nodeInQuestion, searchFor=code_block.out0, replaceWith=code_block.out1)
concat = String.Concat(string, replace)
web_request = WebRequest(concat)
string_2 = StringInput("<h1 class=\"page-title\">Search Results for: <span>theNewSearch</span></h1>")
code_block_2 = CodeBlock { "theNewSearch"; }
replace_2 = String.Replace(str=string_2, searchFor=code_block_2, replaceWith=nodeInQuestion)
indexOf = String.IndexOf(string=web_request, searchFor=replace_2)
code_block_3 = CodeBlock(n=indexOf) { 0; n-1; }
remove = String.Remove(str=web_request, startIndex=code_block_3.out0, count=code_block_3.out1)
string_3 = StringInput("node-index/\" rel=\"bookmark\">")
string_4 = StringInput("</a></h1>")
split = String.Split(remove, string_3, string_4)
code_block_4 = CodeBlock { "Index"; }
contains = String.Contains(str=split, searchFor=code_block_4)
filterByBoolMask = List.FilterByBoolMask(list=split, mask=contains)
deconstruct = List.Deconstruct(list=filterByBoolMask.in)
code_block_5 = CodeBlock { "Node"; }
lastIndexOf = String.LastIndexOf(deconstruct.first, code_block_5)
length = String.Length(deconstruct.first)
code_block_6 = CodeBlock(length=length, index=lastIndexOf) { length-index; }
remove_2 = String.Remove(str=deconstruct.first, startIndex=lastIndexOf, count=code_block_6)
likelyPackage = Output(remove_2)
code_block_7 = CodeBlock { "Node"; }
lastIndexOf_2 = String.LastIndexOf(deconstruct.rest, code_block_7)
length_2 = String.Length(deconstruct.rest)
code_block_8 = CodeBlock(length=length_2, index=lastIndexOf_2) { length-index; }
remove_3 = String.Remove(str=deconstruct.rest, startIndex=lastIndexOf_2, count=code_block_8)
otherPossibilities = Output(remove_3)
