# Dynamo custom node ToDouble.dyf (Dynamo 1.2.1.3083)
# category: Archi-lab_Grimshaw.Strings
# This node converts strings to doubles. When strings look like this: "0", "1" etc. and don't have decimal places the ToNumber node fails on occasion. This addresses that issue.

string = Input()
python_script = Python(IN[0]=string)
# ---------- python_script.python (11 lines) ----------
def ToInteger(i):
	try:
		return float(i)
	except:
		try:
			return float(i + ".0")
		except:
			return None

#Assign your output to the OUT variable.
OUT = map(ToInteger, IN[0])
# ----------------------------------------
double = Output(python_script)
